% Simulink data dictionary formationFlightSimulationData.sldd

ctrlConfigSet = Simulink.ConfigSet(StartTime="0", StopTime="TFinal", RelTol="1e-4", Solver="VariableStepAuto", ProdHWDeviceType="Generic->Unspecified (assume 32-bit Generic)", SystemTargetFile="grt.tlc", TargetLang="C")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
plantConfigSet = Simulink.ConfigSet(StartTime="0", StopTime="TFinal", RelTol="1e-3", Solver="VariableStepAuto", ProdHWDeviceType="Generic->32-bit x86 compatible", SystemTargetFile="grt.tlc", TargetLang="C")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

MultiFixedWingStateBus = Simulink.Bus()
  North: double[5 1]
  East: double[5 1]
  Height: double[5 1]
  AirSpeed: double[5 1]
  HeadingAngle: double[5 1]
  FlightPathAngle: double[5 1]
  RollAngle: double[5 1]
  RollAngleRate: double[5 1]

MultiFixedWingControlBus = Simulink.Bus()
  Height: double[5 1]
  AirSpeed: double[5 1]
  RollAngle: double[5 1]

MultiFixedWingEnvironmentBus = Simulink.Bus()
  WindNorth: double[5 1]
  WindEast: double[5 1]
  WindDown: double[5 1]
  Gravity: double[5 1]